# Requirement set crs_req_func_spec (R2023b)

## 1 [#1] Driver Switch Request Handling
Handle switch operations by the driver to determine the command for the cruise control system to operate upon.

### 1.1 [#2] Switch precedence
If multiple switches are enabled at the same time, the cruise control system takes action in the following order:
1. Cancel
2. Cruise
3. Set
4. Resume
5. Increment
6. Decrement

### 1.2 [#3] Avoid repeating commands
If the following switch operations are repeated, the system should output NoRequest the second time and after as long as the same switch is enabled:
- Cancel
- Cruise
- Set
- Resume

### 1.3 [#4] Long Switch recognition
When the Increment or Decrement switches are pressed for more than 500ms, they are recognized as LongInc and LongDec respectively.

#### 1.3.1 [#5] Waiting state for Long Increment switch detection
When the Increment switch is enabled repeatedly but it does not reach the threshold to be determined as a Long Switch operation, it outputs Inc_Middle so that a downstream function can recognize that the transition can occur.

#### 1.3.2 [#6] Waiting state for Long Decrement switch detection
When the Decrement switch is enabled repeatedly but it does not reach the threshold to be determined as a Long Switch operation, it outputs Dec_Middle so that a downstream function can recognize that the transition can occur.

### 1.4 [#7] Cancel Switch Detection
If the Cancel switch is pressed, the value of reqDrv should be set to reqMode.Cancel.

### 1.5 [#8] Set Switch Detection
If the Set switch is pressed, the value of reqDrv should be set to reqMode.Set.

### 1.6 [#9] Enable Switch Detection
If the Enable switch is pressed, the value of reqDrv should be set to reqMode.Cruise.

### 1.7 [#10] Resume Switch Detection
If the Resume switch is pressed, the value of reqDrv should be set to reqMode.Resume.

### 1.8 [#11] Increment Switch Detection
If the Increment switch is pressed, the value of reqDrv should be set as reqMode.Inc_Short, reqMode.Inc_Middle, or reqMode.Inc_Long depending on how long the switch is kept pressed.

#### 1.8.1 [#12] Increment Short Switch Detection

#### 1.8.2 [#13] Increment Long Switch Detection

#### 1.8.3 [#14] Intermediate state
When the Increment switch is kept pressed and the long switch detection counter has not reached its threshold, it outputs reqMode.Inc_Middle.

### 1.9 [#15] Decrement Switch Detection
If the Decrement switch is pressed, the value of reqDrv should be set as reqMode.Dec_Short, reqMode.Dec_Middle, or reqMode.Dec_Long depending on how long the switch is kept pressed.

#### 1.9.1 [#16] Decrement Short Switch Detection

#### 1.9.2 [#17] Decrement Long Switch Detection

#### 1.9.3 [#18] Intermediate state
When the Decrement switch is kept pressed and the long switch detection counter has not reached its threshold, it outputs reqMode.Dec_Middle.

#### 1.9.4 [#76]

### 1.10 [EnableSWDetection] Cruise control's enable switch : Detection criteria
Switch value : 0 --> 1 (1s maintain)

## 2 [#19] Cruise Control Mode
The Cruise Control Mode module determines the operation mode of the cruise control system.
The operation mode is determined by two types of sources:
1. Output of the Driver Switch Request model
2. Environmental conditions
This module also controls the status indicator used in the instrument panel.

### 2.1 [#20] Disable Cruise Control system
Conditions to disable the cruise control system.

#### 2.1.1 [#21] Key position is not ON
The cruise control system should be disabled when the Key position is not ON.

#### 2.1.2 [#22] Gear position is not Drive
The cruise control system should be disabled when the Gear is not in Drive position.

#### 2.1.3 [#23] Brake pressure is higher than brake_threshold
The cruise control system should be disabled when the brake pressure is higher than brake_threshold.

### 2.2 [#24] Operation mode determination
Determines the current operation mode when no external input is received.
The output operation mode is determined from the requested command and the previous operation mode.

#### 2.2.1 [#25] Precedence of mode determination
The output operation mode has the following priorities (high to low):
- Disable
- Enable
- Resume
- Activate
- Increment
- Decrement

#### 2.2.2 [#26] Disable conditions
Conditions that need to be active for the cruise control system to be disabled.

#### 2.2.3 [#27] Enable conditions
Conditions that need to be active for the cruise control system to be enabled.

#### 2.2.4 [#28] Resume conditions
Conditions that need to be active for the cruise control system to be resume operation.

#### 2.2.5 [#29] Activate conditions
Conditions that need to be active for the cruise control system to be activated.

#### 2.2.6 [#30] Repeat previous operation mode
Repeat the previous operation.

#### 2.2.7 [#31] Increment mode
Increase target speed.

#### 2.2.8 [#32] Increment and hold mode
Increase target speed and hold it.

#### 2.2.9 [#33] Decrement mode
Decrease target speed.

#### 2.2.10 [#34] Decrement and hold mode
Decrease target speed and hold it.

#### 2.2.11 [#35] Out of speed range detection
If vehicle speed is less than tsp_min or higher than tsp_max, the out of speed range flag should be enabled.

#### 2.2.12 [#36] Disabling override
If the conditions for the disabling case are detected, the disable operation mode should be overridden.

## 3 [#37] Calculate Target Speed and Throttle Value
Calculate the target speed and the throttle value.
Input:
- Operation mode
- Vehicle speed
- Throttle value from the driver's accelerator pedal

### 3.1 [#38] Disabled case
If the operation model is disabled, throttle value from the driver's accelerator pedal is used as the output throttle value.
Target Speed value is the minimum target speed.

### 3.2 [#39] Enabled case
If the operation mode is enabled, target speed specifies the current vehicle speed and throttle value is set to the value from the driver's accelerator pedal.

### 3.3 [#40] Activated case
If the operation mode is Activated, the output throttle value is computed as described in Target Speed Computation requirement.

#### 3.3.1 [#41] Throttle Value Computation
Compute the throttle value from the driver's accelerator pedal

#### 3.3.2 [#42] Next Target Speed Computation
Compute the next target speed.

### 3.4 [#43] Resume mode
If the operation mode is resume, the stored target speed described in Target Speed Computation requirement is used as the current target speed and the throttle value and target speed of next step is decided as described in the Activated Case requirement.

## 4 [#44] System Interface (Container)
Cruise control system interface.

### 4.1 [#45] Inputs (Container)
Cruise control system inputs.

#### 4.1.1 [#46] Enable Switch
Data-type: Boolean

#### 4.1.2 [#47] Cancel Switch
Data-type: Boolean

#### 4.1.3 [#48] Set Switch
Data-type: Boolean

#### 4.1.4 [#49] Resume Switch
Data-type: Boolean

#### 4.1.5 [#50] Increment Switch
Data-type: Boolean

#### 4.1.6 [#51] Decrement Switch
Data-type: Boolean

#### 4.1.7 [#52] Brake pressure

#### 4.1.8 [#53] Vehicle speed

#### 4.1.9 [#54] Key position

#### 4.1.10 [#55] Gear position

#### 4.1.11 [#56] Throttle from Driver
Throttle value from the driver's accelerator pedal.

### 4.2 [#57] Outputs (Container)
Outputs from the cruise control system.

#### 4.2.1 [#58] Driver Request
Data-type: Enumeration

#### 4.2.2 [#59] Status
Data-type: Boolean

#### 4.2.3 [#60] Operation Mode
Cruise Control system mode of operation

#### 4.2.4 [#61] Target Speed
Data-type: Single

#### 4.2.5 [#62] Throttle value
Data-type: Single

### 4.3 [#63] Parameters (Container)
Cruise control system parameters.

#### 4.3.1 [#67] Maximum Throttle Value
Minimum value for the throttle should be defined as a parameter.

#### 4.3.2 [#68] Minimum Throttle Value
Minimum value for throttle should be defined as a parameter.

#### 4.3.3 [#69] Maximum Target Speed
Maximum value for target speed should be defined as a parameter.

#### 4.3.4 [#70] Minimum Target Speed
Minimum value for target speed should be defined as a parameter.

#### 4.3.5 [#64] Proportional term
Proportional term of the PI controller

#### 4.3.6 [#65] Integral term
Integral term of the PI controller

#### 4.3.7 [#66] Threshold value for brake pressure
Brake pressure threshold for cruise control to be disabled.

## 5 [#71] Justifications (Justification)
List of justified requirements

### 5.1 [#72] Non-functional requirement (Justification)
A non-functional requirement that cannot be associated with a model element.